# Grasshopper definition master_8.gh (Grasshopper 1.0.7)
# plug-ins: Kangaroo2 Components, Weaverbird, LunchBox

entrance_distance = Slider(14, range=0..30)
# Shell
entrance_radius = Slider(6, range=0..25)
vector_xyz = VectorXYZ(XComponent=0, YComponent=0, ZComponent=0)  # -> Vector, Length
unit_x = UnitX(Factor=entrance_distance)
radius = Slider(14, range=0..30)
plane_origin = PlaneOrigin(Base=vector_xyz.Vector, Origin=unit_x)
circle = Circle(Plane=PlaneXY(0, 0, 0), Radius=radius)
entrance_opening = Slider(7, range=0..20)
circle_2 = Circle(Plane=plane_origin, Radius=entrance_radius)
multiplication = Multiplication(A=entrance_opening, B=-0.5)
trim_with_region = TrimWithRegion(Curve=circle, Region=circle_2)  # -> Inside, Outside
trim_with_region_2 = TrimWithRegion(Curve=circle_2, Region=circle)  # -> Inside, Outside
vector_xyz_2 = VectorXYZ(XComponent=entrance_distance, YComponent=multiplication, ZComponent=0)  # -> Vector, Length
vector_xyz_3 = VectorXYZ(XComponent=0, YComponent=0, ZComponent=0)  # -> Vector, Length
fillet_radius = Slider(8, range=0..10)
hole_radius = Slider(5, range=0..15)
join_curves = JoinCurves(Curves=[trim_with_region.Outside, trim_with_region_2.Outside], Preserve=False)
plane_origin_2 = PlaneOrigin(Base=vector_xyz_3.Vector, Origin=vector_xyz_2.Vector)
fillet = Fillet(Curve=join_curves, Radius=fillet_radius)
rectangle = Rectangle(Plane=plane_origin_2, XSize=entrance_radius, YSize=entrance_opening, Radius=0)  # -> Rectangle, Length
circle_3 = Circle(Plane=PlaneXY(0, 0, 0), Radius=hole_radius)
boundary_surfaces = BoundarySurfaces(Edges=fillet)
trim_with_region_3 = TrimWithRegion(Curve=fillet, Region=rectangle.Rectangle)  # -> Inside, Outside
solid_difference = SolidDifference(BrepsA=circle_3, BrepsB=boundary_surfaces)
surface = Surface(solid_difference)
curve = Curve(trim_with_region_3.Outside)

# ----
# Mesh
mesh_subdivisions = Slider(2, range=0..5)
value_list = ValueList({"Fixed": 0, "Smooth": 1, "Fixed Corners": 2}, selected="Fixed")
weighted_loop_subdivision = WeightedLoopSubdivision(M=surface, L=mesh_subdivisions, E=value_list, TE=1, TV=1)  # -> out, A; inputs M: Mesh, TE: list, TV: list
# ---------- weighted_loop_subdivision: VB ----------
    Component.Params.Input(0).Name = "Mesh"
    Component.Params.Input(0).Description = "An open or closed mesh whose faces should be triangular, all quad faces will be triangulated automatically"
    Component.Params.Input(1).Name = "Loops"
    Component.Params.Input(1).Description = "The number of iterations applied to each face"
    Component.Params.Input(2).Name = "Edge Type"
    Component.Params.Input(2).Description = "0=Fixed, 1=Smooth, 2=Fixed Corners"
    Component.Params.Input(3).Name = "Edge Weight [Vertex]"
    Component.Params.Input(3).Description = "An optional list of double values which overides the percent between the existing edge midpoint and the new smoothed vertex (1=Default)"
    Component.Params.Input(4).Name = "Vertex Weight [Vertex]"
    Component.Params.Input(4).Description = "An optional list of double values which overides the percent between the existing vertex and the new smoothed vertex (1=Default)"

    Component.Params.Output(1).Name = "Mesh"
    Component.Params.Output(1).Description = "If successful, a valid mesh"

    If m IsNot Nothing Then
      Dim ma As New mesh
      Dim i,lp As Integer
      Dim txV,txE As New list(Of Double)
      Dim xV(),xE() As Double
      Dim bn As Boolean
      Dim cb As Boolean

      'input mesh to the looped mesh
      m.weld(math.pi)
      If m.Faces.QuadCount() > 0 Then m.Faces.ConvertQuadsToTriangles
      ma = m

      ' match multiplier and color values to vertex count
      xV = TV.toarray()
      xE = TE.toarray()
      For i = 0 To m.Vertices.count() - 1 Step 1
        txV.add(xV(bC(xV, i)))
        txE.add(xE(bC(xE, i)))
      Next
      xV = txV.toarray()
      xE = txE.toarray()

      bn = m.IsClosed() = False

      For lp = 0 To L - 1 Step 1

        Dim mv As Rhino.Geometry.Collections.MeshVertexList
        Dim mf As Rhino.Geometry.Collections.MeshFaceList
        Dim mfn As Rhino.Geometry.Collections.MeshFaceNormalList
        Dim mc As Rhino.Geometry.Collections.MeshVertexColorList
        Dim mte As Rhino.Geometry.Collections.MeshTopologyEdgeList
        Dim mtv As Rhino.Geometry.Collections.MeshTopologyVertexList
        Dim mnv() As Boolean
        Dim nes As New list(Of Boolean)
        Dim pv() As point3d

        If ma.VertexColors.Count() > 0 Then
          cb = True
        Else
          cb = False
          ma.VertexColors.CreateMonotoneMesh(color.LightBlue)
        End If

        mv = ma.Vertices
        mf = ma.Faces
        mfn = ma.FaceNormals
        mc = ma.VertexColors
        mte = ma.TopologyEdges
        mtv = ma.TopologyVertices

        pv = mv.ToPoint3dArray
        mnv = ma.GetNakedEdgePointStatus

        Dim vo,vt As New list(Of point3d)
        Dim fo As New list(Of MeshFace)
        Dim j,k,u,v,cf,ce,cv As Integer
        Dim fi() As Integer
        Dim p(3) As point3d
        Dim mvi(3) As Integer
        Dim rv,re As New list(Of Double)
        Dim oc As New list(Of color)

        cv = mv.count()
        ce = mte.count()
        cf = mf.count()

        'Faces
        For i = 0 To cf - 1 Step 1
          fi = mtv.IndicesFromFace(i)
          mvi(0) = mtv.MeshVertexIndices(fi(0))(0)
          mvi(1) = mtv.MeshVertexIndices(fi(1))(0)
          mvi(2) = mtv.MeshVertexIndices(fi(2))(0)

          fo.add(New meshface(mte.GetEdgeIndex(fi(0), fi(1)), mte.GetEdgeIndex(fi(1), fi(2)), mte.GetEdgeIndex(fi(2), fi(0))))

          fo.add(New meshface(mte.GetEdgeIndex(fi(0), fi(1)), ce + mvi(1), mte.GetEdgeIndex(fi(1), fi(2))))
          fo.add(New meshface(mte.GetEdgeIndex(fi(1), fi(2)), ce + mvi(2), mte.GetEdgeIndex(fi(2), fi(0))))
          fo.add(New meshface(mte.GetEdgeIndex(fi(2), fi(0)), ce + mvi(0), mte.GetEdgeIndex(fi(0), fi(1))))
        Next

        'Edges
        For i = 0 To ce - 1 Step 1
          Dim cfi() As Integer
          Dim ta,tb As New list(Of Integer)
          Dim cei As Rhino.IndexPair

          cfi = mte.GetConnectedFaces(i)
          cei = mte.GetTopologyVertices(i)
          u = mtv.MeshVertexIndices(cei.I)(0)
          v = mtv.MeshVertexIndices(cei.J)(0)
          p(0) = (pv(u) + pv(v)) / 2

          If ubound(cfi) > 0 Then
            ta = mf.GetTopologicalVertices(cfi(0)).tolist()
            ta.remove(cei.I)
            ta.remove(cei.J)

            tb = mf.GetTopologicalVertices(cfi(1)).tolist()
            tb.remove(cei.I)
            tb.remove(cei.J)

            p(1) = pv(mtv.meshvertexindices(ta(0))(0))
            p(2) = pv(mtv.meshvertexindices(tb(0))(0))
            p(3) = evalP(p(0), pv(u) * 3 / 8 + pv(v) * 3 / 8 + p(1) / 8 + p(2) / 8, (xe(u) + xe(v)) / 2)

            nes.add(False)
          Else
            p(3) = p(0)
            nes.add(True)
          End If

          vo.add(p(3))
          vt.add(p(3))
          rv.add((xV(u) + xV(v)) / 2)
          re.add((xE(u) + xE(v)) / 2)
          oc.add(avgC2(mc(u), mc(v)))
        Next

        'Vertices
        For i = 0 To cv - 1 Step 1
          Dim tvi As Integer
          Dim cvi As New list(Of Integer)
          Dim q(2) As point3d
          Dim bne As Boolean = False

          tvi = mtv.TopologyVertexIndex(i)

          mtv.SortEdges(tvi)

          cvi = mtv.ConnectedTopologyVertices(tvi).tolist()
          cvi.remove(tvi)
          k = cvi.count()

          For j = 0 To k - 1 Step 1
            u = mte.GetEdgeIndex(tvi, cvi.item(j))
            q(0) += pv(mtv.MeshVertexIndices(cvi.item(j))(0))

            If nes(u) Then
              bne = True
              q(2) += pv(mtv.MeshVertexIndices(cvi.item(j))(0))
            End If
          Next

          If bne Then
            If e = 0 Then
              q(1) = pv(i)
            ElseIf e = 2 Then
              If k = 2 Then
                q(1) = pv(i)
              Else
                q(1) = evalP(pv(i), q(2) / 2, 0.25)
              End If
            Else
              q(1) = evalP(pv(i), q(2) / 2, 0.25)
            End If
          Else
            If k = 3 Then
              q(1) = evalp(pv(i), q(0) / k, xv(i) * 9 / 16)
            Else
              q(1) = evalp(pv(i), q(0) / k, xv(i) * 3 / 8)
            End If
          End If


          vo.add(q(1))
          rv.add(xV(i))
          re.add(xE(i))
          oc.add(mc(i))

        Next

        Dim mo As New mesh
        mo.Vertices.AddVertices(vo)
        mo.Faces.AddFaces(fo)
        If cb Then mo.VertexColors.AppendColors(oc.toarray())
        mo.FaceNormals.ComputeFaceNormals()
        mo.Normals.ComputeNormals()

        ma = mo
        xV = rv.toarray()
        xE = re.toarray()

        'Loop
      Next
      A = ma
    End If
# ---------- weighted_loop_subdivision: VB additional code ----------
  Private Function bC(ByVal arrObj() As Double, ByVal t As Integer)
    Dim intOut As Integer
    If t > uBound(arrObj) Then intOut = uBound(arrObj) Else intOut = t
    Return intOut
  End Function

  Private Function evalP(ByVal op As point3d, ByVal tp As Point3d, ByVal t As Double)
    Return New point3d(op + (tp - op) * t)
  End Function

  Private Function avgC2(ByVal c0 As color, ByVal c1 As color)
    Dim r,g,b As Integer
    r = CInt(((CInt(c0.R) + CInt(c1.R)) / 2))
    g = CInt(((CInt(c0.G) + CInt(c1.G)) / 2))
    b = CInt(((CInt(c0.B) + CInt(c1.B)) / 2))

    If R < 0 Then r = 0 Else If r > 255 Then r = 255
    If G < 0 Then g = 0 Else If r > 255 Then g = 255
    If B < 0 Then b = 0 Else If r > 255 Then b = 255

    Return color.FromArgb(r, g, b)
  End Function
# ---------- end weighted_loop_subdivision ----------

deconstruct_mesh = DeconstructMesh(Mesh=weighted_loop_subdivision.A)  # -> Vertices, Faces, Colours, Normals

# ----
# Columns
base_radius = Slider(9, range=0..20)
pi = Pi(Factor=1)
circle_4 = Circle(Plane=PlaneXY(0, 0, 0), Radius=base_radius)
number_of_columns = Slider(5, range=0..10)
height = Slider(10, range=0..20)
rotate = Rotate(Geometry=circle_4, Angle=pi, Plane=PlaneXY(0, 0, 0))  # -> Geometry, Transform
unit_z = UnitZ(Factor=height)
divide_curve = DivideCurve(Curve=rotate.Geometry, Count=number_of_columns, Kinks=False)  # -> Points, Tangents, Parameters
point = Point(unit_x)
merge = Merge(Data1=point, Data2=divide_curve.Points)
closest_point = ClosestPoint(Point=merge, Cloud=deconstruct_mesh.Vertices)  # -> ClosestPoint, CPIndex, Distance
addition = Addition(A=merge, B=unit_z)
anchor = Anchor(Point=closest_point.ClosestPoint, Target=addition, Strength=10000)

# ----
# Window
number_of_points = Slider(250, range=0..300)
height_2 = Slider(6, range=0..20)
divide_curve_2 = DivideCurve(Curve=circle_3, Count=number_of_points, Kinks=False)  # -> Points, Tangents, Parameters
incline = Slider(0.18, range=0..0.2)
deconstruct = Deconstruct(Point=divide_curve_2.Points)  # -> XComponent, YComponent, ZComponent
multiplication_2 = Multiplication(A=deconstruct.XComponent, B=incline)
addition_2 = Addition(A=multiplication_2, B=height_2)
unit_z_2 = UnitZ(Factor=addition_2)
closest_point_2 = ClosestPoint(Point=divide_curve_2.Points, Cloud=deconstruct_mesh.Vertices)  # -> ClosestPoint, CPIndex, Distance
addition_3 = Addition(A=divide_curve_2.Points, B=unit_z_2)
anchor_2 = Anchor(Point=closest_point_2.ClosestPoint, Target=addition_3, Strength=10000)

# ----
# Anchors
number_of_points_2 = Slider(800, range=0..1000)
divide_curve_3 = DivideCurve(Curve=curve, Count=number_of_points_2, Kinks=False)  # -> Points, Tangents, Parameters
closest_point_3 = ClosestPoint(Point=divide_curve_3.Points, Cloud=deconstruct_mesh.Vertices)  # -> ClosestPoint, CPIndex, Distance
anchor_3 = Anchor(Point=closest_point_3.ClosestPoint, Strength=10000)

# ----
# Load
deconstruct_mesh_2 = DeconstructMesh(Mesh=weighted_loop_subdivision.A)  # -> Vertices, Faces, Colours, Normals
force_load = Slider(1, range=0..50)
unit_z_3 = UnitZ(Factor=force_load)
load = Load(Point=deconstruct_mesh_2.Vertices, ForceVector=unit_z_3, Weighting=1)

# ----
# Members
edgelengths = EdgeLengths(Mesh=weighted_loop_subdivision.A, LengthFactor=Slider(0.048, range=0..0.1), Strength=Slider(32, range=10..100))

show = Show(G=weighted_loop_subdivision.A)

# ----
# Simulation
merge_2 = Merge(Data1=show, Data2=[anchor_3, anchor, anchor_2], Data3=edgelengths, Data4=load)
solver = Solver(GoalObjects=merge_2, Reset=Button(), Threshold=1e-15, Tolerance=0.01, On=Toggle(True))  # -> I, V, O

# ----
# Gridshell
number_slider = Slider(350, range=0..1000)
number_slider_2 = Slider(10, range=0..10)
boolean_toggle = BooleanToggle(True)
boolean_toggle_2 = BooleanToggle(True)
explode_tree = ExplodeTree(Data=solver.O)  # -> Branch0, _0000
mesh = Mesh(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)
thickness = Slider(1, range=0..1)
mesh_reduce = MeshReduce(
    Mesh=mesh,
    TargetSize=Slider(400, range=0..1000),
    Distort=Toggle(True),
    Accuracy=Slider(10, range=0..10),
    NormalizeSize=Toggle(True))
weaverbird_s_mesh_window = WeaverbirdsMeshWindow(MeshPolylines=mesh_reduce, Distance=thickness, InsetType=0)
mesh_2 = Mesh(weaverbird_s_mesh_window)

mesh_3 = Mesh(mesh_reduce)
unit_z_4 = UnitZ(Factor=Slider(0.12, range=0..1))
weaverbird_s_offset_mesh = WeaverbirdsOffsetMesh(MeshCurves=mesh_3, Distance=expr("-x", Slider(0.3, range=0..0.3)), OffsetType=0)
create_material = CreateMaterial(
    Diffuse=ColourSwatch(SwatchColor=RGB(144, 187, 255)),
    Specular=ColourSwatch(SwatchColor=RGB(247, 255, 255)),
    Emission=ColourSwatch(SwatchColor=RGB(0, 251, 255)),
    Transparency=Slider(0.6, range=0..1),
    Shine=Slider(60, range=0..100))
create_material_2 = CreateMaterial(
    Diffuse=ColourSwatch(SwatchColor=RGB(136, 58, 23)),
    Specular=RGB(255, 255, 255),
    Emission=ColourSwatch(SwatchColor=RGB(6, 29, 64)),
    Transparency=0,
    Shine=0)
create_material_3 = CreateMaterial(
    Diffuse=ColourSwatch(SwatchColor=RGB(227, 219, 216)),
    Specular=RGB(255, 255, 255),
    Emission=ColourSwatch(SwatchColor=RGB(6, 29, 64)),
    Transparency=0,
    Shine=0)
create_material_4 = CreateMaterial(
    Diffuse=ColourSwatch(SwatchColor=RGB(125, 125, 125)),
    Specular=ColourSwatch(SwatchColor=RGB(125, 125, 125)),
    Emission=RGB(0, 0, 0),
    Transparency=0,
    Shine=Slider(20, range=0..100))
create_material_5 = CreateMaterial(
    Diffuse=ColourSwatch(SwatchColor=RGB(125, 125, 125)),
    Specular=ColourSwatch(SwatchColor=RGB(38, 38, 38)),
    Emission=ColourSwatch(SwatchColor=RGB(5, 5, 5)),
    Transparency=0,
    Shine=Slider(10, range=0..100))
create_material_6 = CreateMaterial(
    Diffuse=ColourSwatch(SwatchColor=RGB(125, 125, 125)),
    Specular=ColourSwatch(SwatchColor=RGB(125, 125, 125)),
    Emission=RGB(0, 0, 0),
    Transparency=Slider(0, range=0..100),
    Shine=Slider(10, range=0..100))

# ----
# Window
mesh_4 = Mesh(mesh_reduce)
weaverbird_s_naked_boundary = WeaverbirdsNakedBoundary(MeshClosedPolylines=mesh_4)
curve_middle = CurveMiddle(Curve=weaverbird_s_naked_boundary)
deconstruct_2 = Deconstruct(Point=curve_middle)  # -> XComponent, YComponent, ZComponent
sort_list = SortList(Keys=deconstruct_2.ZComponent)  # -> Keys, ValuesValuesA
list_item = ListItem(List=sort_list.Keys, Index=1, Wrap=True)
find_similar_member = FindSimilarMember(Data=list_item, Set=deconstruct_2.ZComponent)  # -> Hit, Index
list_item_2 = ListItem(List=weaverbird_s_naked_boundary, Index=find_similar_member.Index, Wrap=True)
curve_2 = Curve(list_item_2)
weaverbird_s_tile = WeaverbirdsTile(MeshCurves=curve_2, FillStrategy=Slider(2, range=0..7), OptIn=2)
weaverbird_s_mesh_window_2 = WeaverbirdsMeshWindow(MeshPolylines=weaverbird_s_tile, Distance=Slider(0.9, range=0..10), InsetType=0)
mesh_edges = MeshEdges(Mesh=weaverbird_s_tile)  # -> NakedEdges, InteriorEdges, NonManifoldEdges
deconstruct_mesh_3 = DeconstructMesh(Mesh=weaverbird_s_tile)  # -> Vertices, Faces, Colours, Normals
curve_3 = Curve(mesh_edges.NakedEdges)

# ----
# Panels
point_2 = Point(flatten(addition))
point_3 = Point(deconstruct_mesh_3.Vertices)
polygon_center = PolygonCenter(Polyline=curve_2)  # -> CenterV, CenterE, CenterA
closest_point_4 = ClosestPoint(Point=polygon_center.CenterV, Cloud=point_3)  # -> ClosestPoint, CPIndex, Distance
list_length = ListLength(List=point_2)
cull_index = CullIndex(List=point_3, Indices=closest_point_4.CPIndex, Wrap=True)
multiplication_3 = Multiplication(A=list_length, B=Slider(2, range=0..10))
weaverbird_s_mesh_window_3 = WeaverbirdsMeshWindow(MeshPolylines=weaverbird_s_offset_mesh, Distance=Slider(0, range=0..100), InsetType=0)
stack_data = StackData(Data=multiplication_3, Stack=list_length)
unit_z_5 = UnitZ(Factor=Slider(0.157, range=0..0.5))
stack_data_2 = StackData(Data=point_2, Stack=stack_data)
number_slider_3 = Slider(0.275, range=0..0.3)
addition_4 = Addition(A=cull_index, B=unit_z_5)
multiplication_4 = Multiplication(A=number_slider_3, B=Slider(2, range=1..3))
unit_z_6 = UnitZ(Factor=Slider(0.7, range=0..5))
unit_z_7 = UnitZ(Factor=multiplication_4)
weaverbird_s_mesh_thicken = WeaverbirdsMeshThicken(MeshCurves=weaverbird_s_mesh_window_3, Distance=number_slider_3, OffsetType=0)
addition_5 = Addition(A=cull_index, B=unit_z_7)
addition_6 = Addition(A=stack_data_2, B=unit_z_6)
deconstruct_mesh_4 = DeconstructMesh(Mesh=weaverbird_s_mesh_thicken)  # -> Vertices, Faces, Colours, Normals
closest_points = ClosestPoints(Point=point_2, Cloud=deconstruct_mesh_4.Vertices, Count=multiplication_3)  # -> ClosestPoint, flatten(CPIndex), Distance
replace_items = ReplaceItems(List=deconstruct_mesh_4.Vertices, Item=addition_6, Indices=closest_points.CPIndex, Wrap=False)
closest_points_2 = ClosestPoints(Point=addition_5, Cloud=replace_items, Count=Slider(11, range=0..100))  # -> ClosestPoint, CPIndex, Distance
smaller_than = SmallerThan(FirstNumber=closest_points_2.Distance, SecondNumber=Slider(0.42, range=0..1))  # -> SmallerThan, OrEqualTo
cull_pattern = CullPattern(List=closest_points_2.CPIndex, CullPattern=smaller_than.SmallerThan)  # -> flatten(List)
cull_pattern_2 = CullPattern(List=closest_points_2.ClosestPoint, CullPattern=smaller_than.SmallerThan)  # -> flatten(List)
closest_point_5 = ClosestPoint(Point=cull_pattern_2, Cloud=addition_4)  # -> flatten(ClosestPoint), CPIndex, Distance
replace_items_2 = ReplaceItems(List=replace_items, Item=closest_point_5.ClosestPoint, Indices=cull_pattern, Wrap=False)
construct_mesh = ConstructMesh(Vertices=replace_items_2, Faces=deconstruct_mesh_4.Faces)
create_material_7 = CreateMaterial(
    Diffuse=ColourSwatch(SwatchColor=RGB(164, 105, 64)),
    Specular=RGB(255, 255, 255),
    Emission=ColourSwatch(SwatchColor=RGB(6, 29, 64)),
    Transparency=Slider(0, range=0..1),
    Shine=0)

mesh_5 = Mesh(weaverbird_s_tile)
move = Move(Geometry=weaverbird_s_mesh_window_2, Motion=unit_z_4)  # -> Geometry, Transform

mesh_6 = Mesh(move.Geometry)

custom_preview = CustomPreview(Geometry=mesh_6, Material=create_material)

# ----
# Tensegrity
point_4 = Point(deconstruct_mesh_3.Vertices)
curve_closest_point = CurveClosestPoint(Point=point_4, Curve=curve_2)  # -> Point, Parameter, Distance
smaller_than_2 = SmallerThan(FirstNumber=curve_closest_point.Distance, SecondNumber=Slider(0.1, range=0..0.1))  # -> SmallerThan, OrEqualTo
cull_pattern_3 = CullPattern(List=point_4, CullPattern=smaller_than_2.SmallerThan)
find_similar_member_2 = FindSimilarMember(Data=Toggle(False), Set=smaller_than_2.SmallerThan)  # -> Hit, Index
deconstruct_3 = Deconstruct(Point=cull_pattern_3)  # -> XComponent, YComponent, ZComponent
list_item_3 = ListItem(List=point_4, Index=find_similar_member_2.Index, Wrap=True)
construct_point = ConstructPoint(XCoordinate=deconstruct_3.XComponent, YCoordinate=deconstruct_3.YComponent, ZCoordinate=0)
deconstruct_4 = Deconstruct(Point=list_item_3)  # -> XComponent, YComponent, ZComponent
vector_xyz_4 = VectorXYZ(XComponent=0, YComponent=0, ZComponent=0)  # -> Vector, Length
construct_point_2 = ConstructPoint(XCoordinate=deconstruct_4.XComponent, YCoordinate=deconstruct_4.YComponent, ZCoordinate=0)
vector_2pt = Vector2Pt(PointA=construct_point_2, PointB=construct_point, Unitize=False)  # -> Vector, Length
plane_origin_3 = PlaneOrigin(Base=vector_xyz_4.Vector, Origin=construct_point_2)
multiplication_5 = Multiplication(A=vector_2pt.Vector, B=Slider(0.65, range=0..1))
addition_7 = Addition(A=construct_point, B=multiplication_5)
pi_2 = Pi(Factor=Slider(0.28, range=0..2))
point_5 = Point(divide_curve.Points)
rotate_2 = Rotate(Geometry=addition_7, Angle=pi_2, Plane=plane_origin_3)  # -> Geometry, Transform
shift_list = ShiftList(List=point_5, Shift=1, Wrap=True)
closest_point_6 = ClosestPoint(Point=point_5, Cloud=rotate_2.Geometry)  # -> ClosestPoint, CPIndex, Distance
line = Line(StartPoint=point_5, EndPoint=shift_list)
replace_items_3 = ReplaceItems(List=rotate_2.Geometry, Item=point_5, Indices=closest_point_6.CPIndex, Wrap=False)
join_curves_2 = JoinCurves(Curves=line, Preserve=False)
curve_closest_point_2 = CurveClosestPoint(Point=replace_items_3, Curve=join_curves_2)  # -> Point, Parameter, Distance
point_6 = Point(curve_closest_point_2.Point)
shift_list_2 = ShiftList(List=point_6, Shift=Slider(-1, range=-5..5), Wrap=True)
line_2 = Line(StartPoint=point_6, EndPoint=cull_pattern_3)
line_3 = Line(StartPoint=cull_pattern_3, EndPoint=shift_list_2)
curve_4 = Curve(line_3)
curve_5 = Curve(line_2)

custom_preview_2 = CustomPreview(Geometry=construct_mesh, Material=create_material_7)
pipe = Pipe(Curve=curve_4, Radius=Slider(0.01, range=0..0.05), Caps=1)
custom_preview_3 = CustomPreview(Geometry=pipe, Material=create_material_3)

# ----
# Square members
number_slider_4 = Slider(7, range=0..10)
point_7 = Point(point)
unit_z_8 = UnitZ(Factor=number_slider_4)
point_8 = Point(flatten(divide_curve.Points))
addition_8 = Addition(A=point_8, B=unit_z_8)
addition_9 = Addition(A=point_7, B=unit_z_8)
line_4 = Line(StartPoint=point_8, EndPoint=addition_8)
clearance = Slider(0.25, range=0..1)
number_slider_5 = Slider(0.1, range=0..0.2)
dom = ConstructDomain(DomainStart=number_slider_5, DomainEnd=expr("-x", number_slider_5))
create_material_8 = CreateMaterial(
    Diffuse=ColourSwatch(SwatchColor=RGB(136, 58, 23)),
    Specular=RGB(255, 255, 255),
    Emission=ColourSwatch(SwatchColor=RGB(6, 29, 64)),
    Transparency=0,
    Shine=0)

# ----
# Support around the door
# Framework
mesh_7 = Mesh(mesh_reduce)
tolerance = Slider(0.1, range=0..0.1)
mesh_edges_2 = MeshEdges(Mesh=mesh_7)  # -> NakedEdges, InteriorEdges, NonManifoldEdges
multiplication_6 = Multiplication(A=incline, B=hole_radius)
curve_6 = Curve(mesh_edges_2.NakedEdges)
curve_middle_2 = CurveMiddle(Curve=curve_6)
deconstruct_mesh_5 = DeconstructMesh(Mesh=mesh_7)  # -> Vertices, Faces, Colours, Normals
deconstruct_5 = Deconstruct(Point=curve_middle_2)  # -> XComponent, YComponent, ZComponent
node_radius = Slider(0.05, range=0..0.3)
subtraction = Subtraction(A=height_2, B=multiplication_6, C=tolerance)
removeduplicatepts = RemoveDuplicatePts(Points=[deconstruct_mesh_3.Vertices, deconstruct_mesh_5.Vertices, cull_pattern_3], Tolerance=0.01)
clearance_2 = Slider(0.25, range=0..1)
larger_than = LargerThan(FirstNumber=deconstruct_5.ZComponent, SecondNumber=tolerance)  # -> LargerThan, OrEqualTo
smaller_than_3 = SmallerThan(FirstNumber=deconstruct_5.ZComponent, SecondNumber=subtraction)  # -> SmallerThan, OrEqualTo
gate_and = GateAnd(A=larger_than.LargerThan, B=smaller_than_3.SmallerThan)
radius_2 = Slider(0.03, range=0..0.1)
dispatch = Dispatch(List=curve_6, DispatchPattern=gate_and)  # -> ListA, ListB
curve_7 = Curve([mesh_edges_2.InteriorEdges, dispatch.ListA, curve_3])
flip_curve = FlipCurve(Curve=curve_7)  # -> Curve, Flag
evaluate_length = EvaluateLength(Curve=flip_curve.Curve, Length=clearance_2, Normalized=False)  # -> Point, Tangent, Parameter
evaluate_length_2 = EvaluateLength(Curve=curve_7, Length=clearance_2, Normalized=False)  # -> Point, Tangent, Parameter
line_5 = Line(StartPoint=evaluate_length_2.Point, EndPoint=evaluate_length.Point)
pipe_2 = Pipe(Curve=line_5, Radius=radius_2, Caps=0)

sphere = Sphere(Base=removeduplicatepts, Radius=node_radius)
custom_preview_4 = CustomPreview(Geometry=pipe_2, Material=create_material_2)

# ----
# Steel
point_9 = Point(deconstruct_mesh_5.Vertices)
deconstruct_6 = Deconstruct(Point=point_9)  # -> XComponent, YComponent, ZComponent
smaller_than_4 = SmallerThan(FirstNumber=deconstruct_6.ZComponent, SecondNumber=Slider(0.1, range=0..0.1))  # -> SmallerThan, OrEqualTo
cull_pattern_4 = CullPattern(List=point_9, CullPattern=smaller_than_4.SmallerThan)
to_polar = ToPolar(Point=cull_pattern_4, System=PlaneXY(0, 0, 0))  # -> Phi, Theta, Radius
door_position = Slider(3, range=0..5)
sort_list_2 = SortList(Keys=to_polar.Phi, ValuesValuesA=cull_pattern_4)  # -> Keys, ValuesValuesA
centre_pentagon_size = Slider(-4.1, range=-5..-3)
shift_list_3 = ShiftList(List=sort_list_2.ValuesValuesA, Shift=1, Wrap=Toggle(False))
list_item_4 = ListItem(List=sort_list_2.ValuesValuesA, Index=expr("-x", door_position), Wrap=True)
list_item_5 = ListItem(List=sort_list_2.ValuesValuesA, Index=door_position, Wrap=True)
offset_curve = OffsetCurve(Curve=join_curves_2, Distance=centre_pentagon_size, Plane=PlaneXY(0, 0, 0), Corners=1)
line_6 = Line(StartPoint=sort_list_2.ValuesValuesA, EndPoint=shift_list_3)
line_7 = Line(StartPoint=list_item_5, EndPoint=list_item_4)
join_curves_3 = JoinCurves(Curves=[line_6, line_7, offset_curve, join_curves_2], Preserve=False)
curve_to_polyline = CurveToPolyline(Curve=join_curves_3, ToleranceDistance=0, ToleranceAngle=0)  # -> Polyline, Segments
explode = Explode(Curve=curve_to_polyline.Polyline, Recursive=True)  # -> Segments, Vertices
unit_z_9 = UnitZ(Factor=expr("-x", Slider(0.24, range=0..1)))
line_8 = Line(explode.Segments)
move_2 = Move(Geometry=line_8, Motion=unit_z_9)  # -> Geometry, Transform
line_9 = Line(move_2.Geometry)
number_slider_6 = Slider(0.125, range=0..0.2)
eval = EvaluateCurve(Curve=line_9, Parameter=Slider(0, range=0..1))  # -> Point, Tangent, Angle
pl = PlaneNormal(Origin=eval.Point, ZAxis=eval.Tangent)
dom_2 = ConstructDomain(DomainStart=number_slider_6, DomainEnd=expr("-x", number_slider_6))
rectangle_2 = Rectangle(Plane=pl, XSize=dom_2, YSize=dom_2, Radius=0)  # -> Rectangle, Length
swp1 = Sweep1(Rail=graft(line_9), Sections=graft(rectangle_2.Rectangle), Miter=1)
cap_holes = CapHoles(Brep=swp1)

unit_z_10 = UnitZ(Factor=expr("-x", number_slider_6))
addition_10 = Addition(A=point_7, B=unit_z_9, C=unit_z_10)
line_10 = Line(StartPoint=addition_10, EndPoint=addition_9)
curve_8 = Curve([line_4, mesh_edges.InteriorEdges, curve_5, line_10])
flip_curve_2 = FlipCurve(Curve=curve_8)  # -> Curve, Flag
evaluate_length_3 = EvaluateLength(Curve=flip_curve_2.Curve, Length=clearance, Normalized=False)  # -> Point, Tangent, Parameter
evaluate_length_4 = EvaluateLength(Curve=curve_8, Length=clearance, Normalized=False)  # -> Point, Tangent, Parameter
line_11 = Line(StartPoint=evaluate_length_4.Point, EndPoint=evaluate_length_3.Point)
line_12 = Line(flatten(line_11))
eval_2 = EvaluateCurve(Curve=line_12, Parameter=Slider(0, range=0..1))  # -> Point, Tangent, Angle
pl_2 = PlaneNormal(Origin=eval_2.Point, ZAxis=eval_2.Tangent)
rectangle_3 = Rectangle(Plane=pl_2, XSize=dom, YSize=dom, Radius=0)  # -> Rectangle, Length
swp1_2 = Sweep1(Rail=graft(line_12), Sections=graft(rectangle_3.Rectangle), Miter=1)
cap_holes_2 = CapHoles(Brep=swp1_2)
custom_preview_5 = CustomPreview(Geometry=cap_holes_2, Material=create_material_8)

perp_frame = PerpFrame(Curve=[flip_curve.Curve, flip_curve_2.Curve], Parameter=[evaluate_length.Parameter, evaluate_length_3.Parameter])
perp_frame_2 = PerpFrame(Curve=[curve_7, curve_8], Parameter=[evaluate_length_2.Parameter, evaluate_length_4.Parameter])
cone = Cone(Base=[perp_frame_2, perp_frame], Radius=radius_2, Length=expr("-x", clearance_2))  # -> Cone, Tip

custom_preview_6 = CustomPreview(Geometry=[cone.Cone, sphere], Material=create_material_4)

# ----
# Floor
point_10 = Point(sort_list_2.ValuesValuesA)
list_length_2 = ListLength(List=point_10)
subtraction_2 = Subtraction(A=list_length_2, B=door_position)
construct_domain = ConstructDomain(DomainStart=door_position, DomainEnd=subtraction_2)
pi_3 = Pi(Factor=2)
pi_4 = Pi(Factor=Slider(0.025, range=0..1))
sub_list = SubList(List=point_10, Domain=construct_domain, Wrap=True)  # -> List, Index
addition_11 = Addition(A=pi_4, B=pi_3)
shift_list_4 = ShiftList(List=sub_list.List, Shift=1, Wrap=True)
construct_domain_2 = ConstructDomain(DomainStart=pi_4, DomainEnd=addition_11)
line_13 = Line(StartPoint=sub_list.List, EndPoint=shift_list_4)
range = Range(Domain=construct_domain_2, Steps=Slider(40, range=0..40))
point_polar = PointPolar(BasePlane=PlaneXY(0, 0, 0), XYAngle=range, ZAngle=0, Offset=1)
join_curves_4 = JoinCurves(Curves=line_13, Preserve=False)
unit_z_11 = UnitZ(Factor=expr("-x", Slider(0.275, range=0..0.5)))
vector_xyz_5 = VectorXYZ(XComponent=0, YComponent=0, ZComponent=0)  # -> Vector, Length
cull_duplicates = CullDuplicates(Points=point_polar, Tolerance=0.1, CullMode=3)  # -> Points, Indices, Valence
patch = Patch(Curves=join_curves_4, Spans=20, Flexibility=1, Trim=True)
move_3 = Move(Geometry=patch, Motion=unit_z_11)  # -> Geometry, Transform
unit_z_12 = UnitZ(Factor=expr("-x", Slider(0.05, range=0..0.1)))
line_sdl = LineSDL(Start=vector_xyz_5.Vector, Direction=cull_duplicates.Points, Length=radius)
unit_z_13 = UnitZ(Factor=expr("-x", Slider(0.065, range=0..0.1)))
sphere_2 = Sphere(Base=point_6, Radius=Slider(0.2, range=0..0.5))
end_points = EndPoints(Curve=line_sdl)  # -> Start, End
extrude = Extrude(Base=patch, Direction=unit_z_12)
extrude_2 = Extrude(Base=move_3.Geometry, Direction=unit_z_13)
curve_closest_point_3 = CurveClosestPoint(Point=end_points.End, Curve=join_curves_4)  # -> Point, Parameter, Distance
solid_difference_2 = SolidDifference(BrepsA=extrude, BrepsB=sphere_2)
create_material_9 = CreateMaterial(
    Diffuse=ColourSwatch(SwatchColor=RGB(105, 96, 93)),
    Specular=RGB(255, 255, 255),
    Emission=ColourSwatch(SwatchColor=RGB(97, 75, 46)),
    Transparency=Slider(0, range=0..1),
    Shine=0)
line_14 = Line(StartPoint=vector_xyz_5.Vector, EndPoint=curve_closest_point_3.Point)
solid_difference_3 = SolidDifference(BrepsA=extrude_2, BrepsB=cap_holes)
create_material_10 = CreateMaterial(
    Diffuse=ColourSwatch(SwatchColor=RGB(105, 96, 93)),
    Specular=RGB(255, 255, 255),
    Emission=ColourSwatch(SwatchColor=RGB(178, 142, 96)),
    Transparency=0,
    Shine=0)
custom_preview_7 = CustomPreview(Geometry=solid_difference_3, Material=create_material_9)
custom_preview_8 = CustomPreview(Geometry=solid_difference_2, Material=create_material_10)
unit_z_14 = UnitZ(Factor=expr("-x", Slider(0.14, range=0..1)))
move_4 = Move(Geometry=line_14, Motion=unit_z_14)  # -> Geometry, Transform
line_15 = Line(move_4.Geometry)
number_slider_7 = Slider(0.1, range=0..0.2)
number_slider_8 = Slider(0.07, range=0..0.2)
eval_3 = EvaluateCurve(Curve=line_15, Parameter=Slider(0, range=0..1))  # -> Point, Tangent, Angle
dom_3 = ConstructDomain(DomainStart=number_slider_7, DomainEnd=expr("-x", number_slider_7))
pl_3 = PlaneNormal(Origin=eval_3.Point, ZAxis=eval_3.Tangent)
dom_4 = ConstructDomain(DomainStart=number_slider_8, DomainEnd=expr("-x", number_slider_8))
rectangle_4 = Rectangle(Plane=pl_3, XSize=dom_4, YSize=dom_3, Radius=0)  # -> Rectangle, Length
swp1_3 = Sweep1(Rail=graft(line_15), Sections=graft(rectangle_4.Rectangle), Miter=1)
cap_holes_3 = CapHoles(Brep=swp1_3)
create_material_11 = CreateMaterial(
    Diffuse=ColourSwatch(SwatchColor=RGB(105, 96, 93)),
    Specular=RGB(255, 255, 255),
    Emission=ColourSwatch(SwatchColor=RGB(178, 142, 96)),
    Transparency=0,
    Shine=0)
custom_preview_9 = CustomPreview(Geometry=cap_holes_3, Material=create_material_11)

# ----
# Wall
door_size = Slider(2.5, range=0..5)
door_spacing = Slider(0.5, range=0..2)
division = Division(A=door_size, B=2)
unit_vector = UnitVector(Vector=line_7)
addition_12 = Addition(A=door_spacing, B=division)
unit_z_15 = UnitZ(Factor=expr("x/2", door_size))
multiplication_7 = Multiplication(A=unit_vector, B=addition_12)
curve_middle_3 = CurveMiddle(Curve=line_7)
multiplication_8 = Multiplication(A=multiplication_7, B=-1)
unit_z_16 = UnitZ(Factor=1)
addition_13 = Addition(A=curve_middle_3, B=multiplication_7, C=unit_z_15)
addition_14 = Addition(A=curve_middle_3, B=multiplication_8, C=unit_z_15)
line_sdl_2 = LineSDL(Start=curve_middle_3, Direction=unit_z_16, Length=1)
dom_5 = ConstructDomain(DomainStart=expr("x/2", door_size), DomainEnd=expr("-x/2", door_size))
line_line = LineLine(LineA=line_7, LineB=line_sdl_2)
plane_origin_4 = PlaneOrigin(Base=line_line, Origin=addition_14)
plane_origin_5 = PlaneOrigin(Base=line_line, Origin=addition_13)
mesh_plane = MeshPlane(Mesh=mesh_7, Plane=line_line)
rectangle_5 = Rectangle(Plane=[plane_origin_4, plane_origin_5], XSize=dom_5, YSize=dom_5, Radius=0)  # -> Rectangle, Length
join_curves_5 = JoinCurves(Curves=[mesh_plane, line_7], Preserve=False)
patch_2 = Patch(Curves=join_curves_5, Spans=20, Flexibility=1, Trim=True)
surface_split = SurfaceSplit(Surface=patch_2, Curves=rectangle_5.Rectangle)
list_item_6 = ListItem(List=surface_split, Index=0, Wrap=True)
unit_x_2 = UnitX(Factor=Slider(0.12, range=0..1))
extrude_3 = Extrude(Base=list_item_6, Direction=unit_x_2)
create_material_12 = CreateMaterial(
    Diffuse=ColourSwatch(SwatchColor=RGB(133, 86, 70)),
    Specular=RGB(255, 255, 255),
    Emission=ColourSwatch(SwatchColor=RGB(87, 74, 56)),
    Transparency=0,
    Shine=0)
custom_preview_10 = CustomPreview(Geometry=extrude_3, Material=create_material_12)

custom_preview_11 = CustomPreview(Geometry=cap_holes, Material=create_material_5)

# ----
# Piles
number_slider_9 = Slider(-3, range=-5..-1)
number_slider_10 = Slider(3, range=1..5)
point_11 = Point(sort_list_2.ValuesValuesA)
series = Series(Start=-1, Step=-1, Count=expr("-x", number_slider_9))
series_2 = Series(Start=0, Step=1, Count=number_slider_10)
cull_index_2 = CullIndex(List=point_11, Indices=[series_2, series], Wrap=True)
list_item_7 = ListItem(List=point_11, Index=[Slider(0, range=-1..0), Slider(-1, range=-1..0), number_slider_10, number_slider_9], Wrap=True)
number_slider_11 = Slider(2, range=0..10)
point_12 = Point(cull_index_2)
vector_xyz_6 = VectorXYZ(XComponent=0, YComponent=0, ZComponent=0)  # -> Vector, Length
point_13 = Point(point_5)
list_length_3 = ListLength(List=point_12)
division_2 = Division(A=list_length_3, B=number_slider_11)
line_16 = Line(StartPoint=vector_xyz_6.Vector, EndPoint=point_13)
series_3 = Series(Start=number_slider_11, Step=number_slider_11, Count=division_2)
list_item_8 = ListItem(List=point_12, Index=series_3, Wrap=True)
curve_curve = CurveCurve(CurveA=line_16, CurveB=offset_curve)  # -> Points, ParamsA, ParamsB
cull_duplicates_2 = CullDuplicates(Points=[list_item_8, list_item_7], Tolerance=0.1, CullMode=3)  # -> Points, Indices, Valence
point_14 = Point([curve_curve.Points, point_13])
point_15 = Point(flatten(cull_duplicates_2.Points))
point_16 = Point(flatten([point_14, point]))

# ----
# Screws
screws_per_pile = Slider(6, range=0..10)
screw_resolution = Slider(20, range=0..100)
screw_radius = Slider(0.5, range=0..0.5)
radius_3 = Slider(0.03, range=0..0.1)
length = Slider(8, range=0..10)
screw_tilt = Slider(0.2, range=0..0.2)
unit_z_17 = UnitZ(Factor=-1)
plane_normal = PlaneNormal(Origin=point_16, ZAxis=unit_z_17)
cylinder = Cylinder(Base=plane_normal, Radius=radius_3, Length=length)
addition_15 = Addition(A=screws_per_pile, B=1)
construct_domain_3 = ConstructDomain(DomainStart=1, DomainEnd=expr("x-1", length))
pi_5 = Pi(Factor=Slider(0.139, range=0..1))
unit_vector_2 = UnitVector(Vector=point_15)
tangent = Tangent(Value=pi_5)
unit_z_18 = UnitZ(Factor=-1)
range_2 = Range(Domain=construct_domain_3, Steps=screws_per_pile)
multiplication_9 = Multiplication(A=unit_vector_2, B=tangent)
addition_16 = Addition(A=screws_per_pile, B=1)
construct_domain_4 = ConstructDomain(DomainStart=1, DomainEnd=expr("x-1", length))
addition_17 = Addition(A=unit_z_18, B=multiplication_9)
unit_vector_3 = UnitVector(Vector=addition_17)
list_length_4 = ListLength(List=unit_vector_3)  # -> expr("x", Length)
multiplication_10 = Multiplication(A=list_length_4, B=addition_15)
stack_data_3 = StackData(Data=addition_15, Stack=list_length_4)
stack_data_4 = StackData(Data=unit_vector_3, Stack=stack_data_3)
repeat_data = RepeatData(Data=range_2, Length=multiplication_10)
list_length_5 = ListLength(List=point_16)  # -> expr("x", Length)
unit_z_19 = UnitZ(Factor=expr("-x", 1))
pi_6 = Pi(Factor=2)
pi_7 = Pi(Factor=screw_tilt)
multiplication_11 = Multiplication(A=stack_data_4, B=repeat_data)
plane_normal_2 = PlaneNormal(Origin=point_15, ZAxis=addition_17)
range_3 = Range(Domain=construct_domain_4, Steps=screws_per_pile)
stack_data_5 = StackData(Data=point_15, Stack=stack_data_3)
multiplication_12 = Multiplication(A=list_length_5, B=addition_16)
stack_data_6 = StackData(Data=addition_16, Stack=list_length_5)
cylinder_2 = Cylinder(Base=plane_normal_2, Radius=radius_3, Length=length)
construct_domain_5 = ConstructDomain(DomainStart=expr("-x", pi_7), DomainEnd=pi_7)
construct_domain_6 = ConstructDomain(DomainStart=0, DomainEnd=pi_6)
stack_data_7 = StackData(Data=unit_z_19, Stack=stack_data_6)
addition_18 = Addition(A=stack_data_5, B=multiplication_11)
repeat_data_2 = RepeatData(Data=range_3, Length=multiplication_12)
range_4 = Range(Domain=construct_domain_6, Steps=screw_resolution)
range_5 = Range(Domain=construct_domain_5, Steps=screw_resolution)
plane_normal_3 = PlaneNormal(Origin=addition_18, ZAxis=stack_data_4)
multiplication_13 = Multiplication(A=stack_data_7, B=repeat_data_2)
stack_data_8 = StackData(Data=point_16, Stack=stack_data_6)
addition_19 = Addition(A=stack_data_8, B=multiplication_13)
point_polar_2 = PointPolar(BasePlane=plane_normal_3, XYAngle=graft(range_4), ZAngle=graft(range_5), Offset=screw_radius)  # -> simplify(Point)
plane_normal_4 = PlaneNormal(Origin=addition_19, ZAxis=unit_z_19)
point_polar_3 = PointPolar(BasePlane=plane_normal_4, XYAngle=graft(range_4), ZAngle=graft(range_5), Offset=screw_radius)  # -> simplify(Point)
line_17 = Line(StartPoint=addition_18, EndPoint=point_polar_2)
flip_matrix = FlipMatrix(Data=line_17)
line_18 = Line(StartPoint=addition_19, EndPoint=point_polar_3)
loft = Loft(Curves=flip_matrix, Options={Adjust=False, Closed=False, LoftEnds=0, LoftSimp=0, LoftType=0, Rebuild=10, Refit=0.01})
flip_matrix_2 = FlipMatrix(Data=line_18)
loft_2 = Loft(Curves=flip_matrix_2, Options={Adjust=False, Closed=False, LoftEnds=0, LoftSimp=0, LoftType=0, Rebuild=10, Refit=0.01})
move_5 = Move(Geometry=[loft, cylinder_2, loft_2, cylinder], Motion=unit_z_9)  # -> Geometry, Transform

custom_preview_12 = CustomPreview(Geometry=move_5.Geometry, Material=create_material_6)
