# Grasshopper definition panels_2.gh (Grasshopper 1.0.7)
# plug-ins: Kangaroo2 Components, Weaverbird, LunchBox

entrance_distance = Slider(14, range=0..30)
# Shell
entrance_radius = Slider(6, range=0..25)
vector_xyz = VectorXYZ(XComponent=0, YComponent=0, ZComponent=0)  # -> Vector, Length
unit_x = UnitX(Factor=entrance_distance)
radius = Slider(14, range=0..30)
plane_origin = PlaneOrigin(Base=vector_xyz.Vector, Origin=unit_x)
circle = Circle(Plane=PlaneXY(0, 0, 0), Radius=radius)
entrance_opening = Slider(7, range=0..20)
circle_2 = Circle(Plane=plane_origin, Radius=entrance_radius)
multiplication = Multiplication(A=entrance_opening, B=-0.5)
trim_with_region = TrimWithRegion(Curve=circle, Region=circle_2)  # -> Inside, Outside
trim_with_region_2 = TrimWithRegion(Curve=circle_2, Region=circle)  # -> Inside, Outside
vector_xyz_2 = VectorXYZ(XComponent=entrance_distance, YComponent=multiplication, ZComponent=0)  # -> Vector, Length
vector_xyz_3 = VectorXYZ(XComponent=0, YComponent=0, ZComponent=0)  # -> Vector, Length
fillet_radius = Slider(8, range=0..10)
hole_radius = Slider(5, range=0..15)
join_curves = JoinCurves(Curves=[trim_with_region.Outside, trim_with_region_2.Outside], Preserve=False)
plane_origin_2 = PlaneOrigin(Base=vector_xyz_3.Vector, Origin=vector_xyz_2.Vector)
fillet = Fillet(Curve=join_curves, Radius=fillet_radius)
rectangle = Rectangle(Plane=plane_origin_2, XSize=entrance_radius, YSize=entrance_opening, Radius=0)  # -> Rectangle, Length
circle_3 = Circle(Plane=PlaneXY(0, 0, 0), Radius=hole_radius)
boundary_surfaces = BoundarySurfaces(Edges=fillet)
trim_with_region_3 = TrimWithRegion(Curve=fillet, Region=rectangle.Rectangle)  # -> Inside, Outside
solid_difference = SolidDifference(BrepsA=circle_3, BrepsB=boundary_surfaces)
surface = Surface(solid_difference)
curve = Curve(trim_with_region_3.Outside)

# ----
# Mesh
mesh_subdivisions = Slider(2, range=0..5)
value_list = ValueList({"Fixed": 0, "Smooth": 1, "Fixed Corners": 2}, selected="Fixed")
weighted_loop_subdivision = WeightedLoopSubdivision(M=surface, L=mesh_subdivisions, E=value_list, TE=1, TV=1)  # -> out, A; inputs M: Mesh, TE: list, TV: list
# ---------- weighted_loop_subdivision: VB ----------
    Component.Params.Input(0).Name = "Mesh"
    Component.Params.Input(0).Description = "An open or closed mesh whose faces should be triangular, all quad faces will be triangulated automatically"
    Component.Params.Input(1).Name = "Loops"
    Component.Params.Input(1).Description = "The number of iterations applied to each face"
    Component.Params.Input(2).Name = "Edge Type"
    Component.Params.Input(2).Description = "0=Fixed, 1=Smooth, 2=Fixed Corners"
    Component.Params.Input(3).Name = "Edge Weight [Vertex]"
    Component.Params.Input(3).Description = "An optional list of double values which overides the percent between the existing edge midpoint and the new smoothed vertex (1=Default)"
    Component.Params.Input(4).Name = "Vertex Weight [Vertex]"
    Component.Params.Input(4).Description = "An optional list of double values which overides the percent between the existing vertex and the new smoothed vertex (1=Default)"

    Component.Params.Output(1).Name = "Mesh"
    Component.Params.Output(1).Description = "If successful, a valid mesh"

    If m IsNot Nothing Then
      Dim ma As New mesh
      Dim i,lp As Integer
      Dim txV,txE As New list(Of Double)
      Dim xV(),xE() As Double
      Dim bn As Boolean
      Dim cb As Boolean

      'input mesh to the looped mesh
      m.weld(math.pi)
      If m.Faces.QuadCount() > 0 Then m.Faces.ConvertQuadsToTriangles
      ma = m

      ' match multiplier and color values to vertex count
      xV = TV.toarray()
      xE = TE.toarray()
      For i = 0 To m.Vertices.count() - 1 Step 1
        txV.add(xV(bC(xV, i)))
        txE.add(xE(bC(xE, i)))
      Next
      xV = txV.toarray()
      xE = txE.toarray()

      bn = m.IsClosed() = False

      For lp = 0 To L - 1 Step 1

        Dim mv As Rhino.Geometry.Collections.MeshVertexList
        Dim mf As Rhino.Geometry.Collections.MeshFaceList
        Dim mfn As Rhino.Geometry.Collections.MeshFaceNormalList
        Dim mc As Rhino.Geometry.Collections.MeshVertexColorList
        Dim mte As Rhino.Geometry.Collections.MeshTopologyEdgeList
        Dim mtv As Rhino.Geometry.Collections.MeshTopologyVertexList
        Dim mnv() As Boolean
        Dim nes As New list(Of Boolean)
        Dim pv() As point3d

        If ma.VertexColors.Count() > 0 Then
          cb = True
        Else
          cb = False
          ma.VertexColors.CreateMonotoneMesh(color.LightBlue)
        End If

        mv = ma.Vertices
        mf = ma.Faces
        mfn = ma.FaceNormals
        mc = ma.VertexColors
        mte = ma.TopologyEdges
        mtv = ma.TopologyVertices

        pv = mv.ToPoint3dArray
        mnv = ma.GetNakedEdgePointStatus

        Dim vo,vt As New list(Of point3d)
        Dim fo As New list(Of MeshFace)
        Dim j,k,u,v,cf,ce,cv As Integer
        Dim fi() As Integer
        Dim p(3) As point3d
        Dim mvi(3) As Integer
        Dim rv,re As New list(Of Double)
        Dim oc As New list(Of color)

        cv = mv.count()
        ce = mte.count()
        cf = mf.count()

        'Faces
        For i = 0 To cf - 1 Step 1
          fi = mtv.IndicesFromFace(i)
          mvi(0) = mtv.MeshVertexIndices(fi(0))(0)
          mvi(1) = mtv.MeshVertexIndices(fi(1))(0)
          mvi(2) = mtv.MeshVertexIndices(fi(2))(0)

          fo.add(New meshface(mte.GetEdgeIndex(fi(0), fi(1)), mte.GetEdgeIndex(fi(1), fi(2)), mte.GetEdgeIndex(fi(2), fi(0))))

          fo.add(New meshface(mte.GetEdgeIndex(fi(0), fi(1)), ce + mvi(1), mte.GetEdgeIndex(fi(1), fi(2))))
          fo.add(New meshface(mte.GetEdgeIndex(fi(1), fi(2)), ce + mvi(2), mte.GetEdgeIndex(fi(2), fi(0))))
          fo.add(New meshface(mte.GetEdgeIndex(fi(2), fi(0)), ce + mvi(0), mte.GetEdgeIndex(fi(0), fi(1))))
        Next

        'Edges
        For i = 0 To ce - 1 Step 1
          Dim cfi() As Integer
          Dim ta,tb As New list(Of Integer)
          Dim cei As Rhino.IndexPair

          cfi = mte.GetConnectedFaces(i)
          cei = mte.GetTopologyVertices(i)
          u = mtv.MeshVertexIndices(cei.I)(0)
          v = mtv.MeshVertexIndices(cei.J)(0)
          p(0) = (pv(u) + pv(v)) / 2

          If ubound(cfi) > 0 Then
            ta = mf.GetTopologicalVertices(cfi(0)).tolist()
            ta.remove(cei.I)
            ta.remove(cei.J)

            tb = mf.GetTopologicalVertices(cfi(1)).tolist()
            tb.remove(cei.I)
            tb.remove(cei.J)

            p(1) = pv(mtv.meshvertexindices(ta(0))(0))
            p(2) = pv(mtv.meshvertexindices(tb(0))(0))
            p(3) = evalP(p(0), pv(u) * 3 / 8 + pv(v) * 3 / 8 + p(1) / 8 + p(2) / 8, (xe(u) + xe(v)) / 2)

            nes.add(False)
          Else
            p(3) = p(0)
            nes.add(True)
          End If

          vo.add(p(3))
          vt.add(p(3))
          rv.add((xV(u) + xV(v)) / 2)
          re.add((xE(u) + xE(v)) / 2)
          oc.add(avgC2(mc(u), mc(v)))
        Next

        'Vertices
        For i = 0 To cv - 1 Step 1
          Dim tvi As Integer
          Dim cvi As New list(Of Integer)
          Dim q(2) As point3d
          Dim bne As Boolean = False

          tvi = mtv.TopologyVertexIndex(i)

          mtv.SortEdges(tvi)

          cvi = mtv.ConnectedTopologyVertices(tvi).tolist()
          cvi.remove(tvi)
          k = cvi.count()

          For j = 0 To k - 1 Step 1
            u = mte.GetEdgeIndex(tvi, cvi.item(j))
            q(0) += pv(mtv.MeshVertexIndices(cvi.item(j))(0))

            If nes(u) Then
              bne = True
              q(2) += pv(mtv.MeshVertexIndices(cvi.item(j))(0))
            End If
          Next

          If bne Then
            If e = 0 Then
              q(1) = pv(i)
            ElseIf e = 2 Then
              If k = 2 Then
                q(1) = pv(i)
              Else
                q(1) = evalP(pv(i), q(2) / 2, 0.25)
              End If
            Else
              q(1) = evalP(pv(i), q(2) / 2, 0.25)
            End If
          Else
            If k = 3 Then
              q(1) = evalp(pv(i), q(0) / k, xv(i) * 9 / 16)
            Else
              q(1) = evalp(pv(i), q(0) / k, xv(i) * 3 / 8)
            End If
          End If


          vo.add(q(1))
          rv.add(xV(i))
          re.add(xE(i))
          oc.add(mc(i))

        Next

        Dim mo As New mesh
        mo.Vertices.AddVertices(vo)
        mo.Faces.AddFaces(fo)
        If cb Then mo.VertexColors.AppendColors(oc.toarray())
        mo.FaceNormals.ComputeFaceNormals()
        mo.Normals.ComputeNormals()

        ma = mo
        xV = rv.toarray()
        xE = re.toarray()

        'Loop
      Next
      A = ma
    End If
# ---------- weighted_loop_subdivision: VB additional code ----------
  Private Function bC(ByVal arrObj() As Double, ByVal t As Integer)
    Dim intOut As Integer
    If t > uBound(arrObj) Then intOut = uBound(arrObj) Else intOut = t
    Return intOut
  End Function

  Private Function evalP(ByVal op As point3d, ByVal tp As Point3d, ByVal t As Double)
    Return New point3d(op + (tp - op) * t)
  End Function

  Private Function avgC2(ByVal c0 As color, ByVal c1 As color)
    Dim r,g,b As Integer
    r = CInt(((CInt(c0.R) + CInt(c1.R)) / 2))
    g = CInt(((CInt(c0.G) + CInt(c1.G)) / 2))
    b = CInt(((CInt(c0.B) + CInt(c1.B)) / 2))

    If R < 0 Then r = 0 Else If r > 255 Then r = 255
    If G < 0 Then g = 0 Else If r > 255 Then g = 255
    If B < 0 Then b = 0 Else If r > 255 Then b = 255

    Return color.FromArgb(r, g, b)
  End Function
# ---------- end weighted_loop_subdivision ----------

deconstruct_mesh = DeconstructMesh(Mesh=weighted_loop_subdivision.A)  # -> Vertices, Faces, Colours, Normals

# ----
# Columns
base_radius = Slider(9, range=0..20)
pi = Pi(Factor=1)
circle_4 = Circle(Plane=PlaneXY(0, 0, 0), Radius=base_radius)
number_of_columns = Slider(5, range=0..10)
height = Slider(10, range=0..20)
rotate = Rotate(Geometry=circle_4, Angle=pi, Plane=PlaneXY(0, 0, 0))  # -> Geometry, Transform
unit_z = UnitZ(Factor=height)
divide_curve = DivideCurve(Curve=rotate.Geometry, Count=number_of_columns, Kinks=False)  # -> Points, Tangents, Parameters
point = Point(unit_x)
merge = Merge(Data1=point, Data2=divide_curve.Points)
closest_point = ClosestPoint(Point=merge, Cloud=deconstruct_mesh.Vertices)  # -> ClosestPoint, CPIndex, Distance
addition = Addition(A=merge, B=unit_z)
anchor = Anchor(Point=closest_point.ClosestPoint, Target=addition, Strength=10000)

# ----
# Window
number_of_points = Slider(250, range=0..300)
height_2 = Slider(6, range=0..20)
divide_curve_2 = DivideCurve(Curve=circle_3, Count=number_of_points, Kinks=False)  # -> Points, Tangents, Parameters
incline = Slider(0.18, range=0..0.2)
deconstruct = Deconstruct(Point=divide_curve_2.Points)  # -> XComponent, YComponent, ZComponent
multiplication_2 = Multiplication(A=deconstruct.XComponent, B=incline)
addition_2 = Addition(A=multiplication_2, B=height_2)
unit_z_2 = UnitZ(Factor=addition_2)
closest_point_2 = ClosestPoint(Point=divide_curve_2.Points, Cloud=deconstruct_mesh.Vertices)  # -> ClosestPoint, CPIndex, Distance
addition_3 = Addition(A=divide_curve_2.Points, B=unit_z_2)
anchor_2 = Anchor(Point=closest_point_2.ClosestPoint, Target=addition_3, Strength=10000)

# ----
# Anchors
number_of_points_2 = Slider(800, range=0..1000)
divide_curve_3 = DivideCurve(Curve=curve, Count=number_of_points_2, Kinks=False)  # -> Points, Tangents, Parameters
closest_point_3 = ClosestPoint(Point=divide_curve_3.Points, Cloud=deconstruct_mesh.Vertices)  # -> ClosestPoint, CPIndex, Distance
anchor_3 = Anchor(Point=closest_point_3.ClosestPoint, Strength=10000)

# ----
# Load
deconstruct_mesh_2 = DeconstructMesh(Mesh=weighted_loop_subdivision.A)  # -> Vertices, Faces, Colours, Normals
force_load = Slider(1, range=0..50)
unit_z_3 = UnitZ(Factor=force_load)
load = Load(Point=deconstruct_mesh_2.Vertices, ForceVector=unit_z_3, Weighting=1)

# ----
# Members
edgelengths = EdgeLengths(Mesh=weighted_loop_subdivision.A, LengthFactor=Slider(0.048, range=0..0.1), Strength=Slider(32, range=10..100))

show = Show(G=weighted_loop_subdivision.A)

# ----
# Simulation
merge_2 = Merge(Data1=show, Data2=[anchor_3, anchor, anchor_2], Data3=edgelengths, Data4=load)
solver = Solver(GoalObjects=merge_2, Reset=Button(), Threshold=1e-15, Tolerance=0.01, On=Toggle(True))  # -> I, V, O

# ----
# Gridshell
number_slider = Slider(350, range=0..1000)
number_slider_2 = Slider(10, range=0..10)
boolean_toggle = BooleanToggle(True)
boolean_toggle_2 = BooleanToggle(True)
explode_tree = ExplodeTree(Data=solver.O)  # -> Branch0, _0000
mesh = Mesh(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)
thickness = Slider(1, range=0..1)
mesh_reduce = MeshReduce(
    Mesh=mesh,
    TargetSize=Slider(400, range=0..1000),
    Distort=Toggle(True),
    Accuracy=Slider(10, range=0..10),
    NormalizeSize=Toggle(True))
weaverbird_s_mesh_window = WeaverbirdsMeshWindow(MeshPolylines=mesh_reduce, Distance=thickness, InsetType=0)
mesh_2 = Mesh(weaverbird_s_mesh_window)

# ----
# Window
mesh_3 = Mesh(mesh_reduce)
weaverbird_s_naked_boundary = WeaverbirdsNakedBoundary(MeshClosedPolylines=mesh_3)
curve_middle = CurveMiddle(Curve=weaverbird_s_naked_boundary)
deconstruct_2 = Deconstruct(Point=curve_middle)  # -> XComponent, YComponent, ZComponent
sort_list = SortList(Keys=deconstruct_2.ZComponent)  # -> Keys, ValuesValuesA
list_item = ListItem(List=sort_list.Keys, Index=1, Wrap=True)
find_similar_member = FindSimilarMember(Data=list_item, Set=deconstruct_2.ZComponent)  # -> Hit, Index
list_item_2 = ListItem(List=weaverbird_s_naked_boundary, Index=find_similar_member.Index, Wrap=True)
curve_2 = Curve(list_item_2)
weaverbird_s_tile = WeaverbirdsTile(MeshCurves=curve_2, FillStrategy=Slider(2, range=0..7), OptIn=2)
weaverbird_s_mesh_window_2 = WeaverbirdsMeshWindow(MeshPolylines=weaverbird_s_tile, Distance=Slider(2.2, range=0..10), InsetType=0)
mesh_edges = MeshEdges(Mesh=weaverbird_s_tile)  # -> NakedEdges, InteriorEdges, NonManifoldEdges
deconstruct_mesh_3 = DeconstructMesh(Mesh=weaverbird_s_tile)  # -> Vertices, Faces, Colours, Normals
mesh_4 = Mesh(weaverbird_s_mesh_window_2)
curve_3 = Curve([mesh_edges.NakedEdges, mesh_edges.InteriorEdges])

mesh_5 = Mesh(mesh_reduce)
mesh_6 = Mesh(weaverbird_s_tile)
weaverbird_s_offset_mesh = WeaverbirdsOffsetMesh(MeshCurves=mesh_5, Distance=expr("-x", Slider(0.3, range=0..0.3)), OffsetType=0)

# ----
# Mesh Setup
point_2 = Point(flatten(addition))
point_3 = Point(deconstruct_mesh_3.Vertices)
polygon_center = PolygonCenter(Polyline=curve_2)  # -> CenterV, CenterE, CenterA
closest_point_4 = ClosestPoint(Point=polygon_center.CenterV, Cloud=point_3)  # -> ClosestPoint, CPIndex, Distance
list_length = ListLength(List=point_2)
cull_index = CullIndex(List=point_3, Indices=closest_point_4.CPIndex, Wrap=True)
multiplication_3 = Multiplication(A=list_length, B=Slider(4, range=0..10))
weaverbird_s_mesh_window_3 = WeaverbirdsMeshWindow(MeshPolylines=weaverbird_s_offset_mesh, Distance=Slider(0, range=0..100), InsetType=0)
stack_data = StackData(Data=multiplication_3, Stack=list_length)
unit_z_4 = UnitZ(Factor=Slider(0.31, range=0..0.5))
stack_data_2 = StackData(Data=point_2, Stack=stack_data)
number_slider_3 = Slider(0.275, range=0..0.3)
weaverbird_s_mesh_thicken = WeaverbirdsMeshThicken(MeshCurves=weaverbird_s_mesh_window_3, Distance=Slider(0.001, range=0..0.3), OffsetType=0)
addition_4 = Addition(A=cull_index, B=unit_z_4)
multiplication_4 = Multiplication(A=number_slider_3, B=Slider(2.36, range=1..3))
unit_z_5 = UnitZ(Factor=Slider(0.7, range=0..5))
unit_z_6 = UnitZ(Factor=multiplication_4)
weaverbird_s_mesh_thicken_2 = WeaverbirdsMeshThicken(MeshCurves=weaverbird_s_mesh_thicken, Distance=number_slider_3, OffsetType=0)
addition_5 = Addition(A=cull_index, B=unit_z_6)
addition_6 = Addition(A=stack_data_2, B=unit_z_5)
mesh_closest_point = MeshClosestPoint(Point=addition_5, Mesh=weaverbird_s_mesh_thicken_2)  # -> Point, Index, Parameter
deconstruct_mesh_4 = DeconstructMesh(Mesh=weaverbird_s_mesh_thicken_2)  # -> Vertices, Faces, Colours, Normals
closest_points = ClosestPoints(Point=point_2, Cloud=deconstruct_mesh_4.Vertices, Count=multiplication_3)  # -> ClosestPoint, flatten(CPIndex), Distance
replace_items = ReplaceItems(List=deconstruct_mesh_4.Vertices, Item=addition_6, Indices=closest_points.CPIndex, Wrap=False)
closest_points_2 = ClosestPoints(Point=mesh_closest_point.Point, Cloud=replace_items, Count=Slider(6, range=0..20))  # -> ClosestPoint, CPIndex, Distance
smaller_than = SmallerThan(FirstNumber=closest_points_2.Distance, SecondNumber=Slider(0.25, range=0..1))  # -> SmallerThan, OrEqualTo
cull_pattern = CullPattern(List=closest_points_2.CPIndex, CullPattern=smaller_than.SmallerThan)  # -> flatten(List)
cull_pattern_2 = CullPattern(List=closest_points_2.ClosestPoint, CullPattern=smaller_than.SmallerThan)
closest_point_5 = ClosestPoint(Point=cull_pattern_2, Cloud=addition_4)  # -> flatten(ClosestPoint), CPIndex, Distance
replace_items_2 = ReplaceItems(List=replace_items, Item=closest_point_5.ClosestPoint, Indices=cull_pattern, Wrap=False)
construct_mesh = ConstructMesh(Vertices=replace_items_2, Faces=deconstruct_mesh_4.Faces)
create_material = CreateMaterial(
    Diffuse=ColourSwatch(SwatchColor=RGB(164, 105, 64)),
    Specular=RGB(255, 255, 255),
    Emission=ColourSwatch(SwatchColor=RGB(6, 29, 64)),
    Transparency=Slider(0, range=0..1),
    Shine=0)

create_material_2 = CreateMaterial(
    Diffuse=ColourSwatch(SwatchColor=RGB(144, 187, 255)),
    Specular=ColourSwatch(SwatchColor=RGB(247, 255, 255)),
    Emission=ColourSwatch(SwatchColor=RGB(4, 251, 255)),
    Transparency=Slider(0.6, range=0..1),
    Shine=Slider(59, range=0..100))
custom_preview = CustomPreview(Geometry=mesh_4, Material=create_material_2)
custom_preview_2 = CustomPreview(Geometry=construct_mesh, Material=create_material)  # disabled

# ----
# Support around the door
# Framework
mesh_7 = Mesh(mesh_reduce)
tolerance = Slider(0.1, range=0..0.1)
mesh_edges_2 = MeshEdges(Mesh=mesh_7)  # -> NakedEdges, InteriorEdges, NonManifoldEdges
multiplication_5 = Multiplication(A=incline, B=hole_radius)
curve_4 = Curve(mesh_edges_2.NakedEdges)
curve_middle_2 = CurveMiddle(Curve=curve_4)
deconstruct_mesh_5 = DeconstructMesh(Mesh=mesh_7)  # -> Vertices, Faces, Colours, Normals
deconstruct_3 = Deconstruct(Point=curve_middle_2)  # -> XComponent, YComponent, ZComponent
node_radius = Slider(0.05, range=0..0.3)
subtraction = Subtraction(A=height_2, B=multiplication_5, C=tolerance)
removeduplicatepts = RemoveDuplicatePts(Points=[deconstruct_mesh_3.Vertices, deconstruct_mesh_5.Vertices], Tolerance=0.01)
clearance = Slider(0.2, range=0..1)
larger_than = LargerThan(FirstNumber=deconstruct_3.ZComponent, SecondNumber=tolerance)  # -> LargerThan, OrEqualTo
smaller_than_2 = SmallerThan(FirstNumber=deconstruct_3.ZComponent, SecondNumber=subtraction)  # -> SmallerThan, OrEqualTo
mesh_sphere = MeshSphere(Base=removeduplicatepts, Radius=node_radius, UCount=10, VCount=20)
gate_and = GateAnd(A=larger_than.LargerThan, B=smaller_than_2.SmallerThan)
radius_2 = Slider(0.03, range=0..0.1)
dispatch = Dispatch(List=curve_4, DispatchPattern=gate_and)  # -> ListA, ListB
curve_5 = Curve([mesh_edges_2.InteriorEdges, dispatch.ListA, curve_3])
flip_curve = FlipCurve(Curve=curve_5)  # -> Curve, Flag
evaluate_length = EvaluateLength(Curve=flip_curve.Curve, Length=clearance, Normalized=False)  # -> Point, Tangent, Parameter
evaluate_length_2 = EvaluateLength(Curve=curve_5, Length=clearance, Normalized=False)  # -> Point, Tangent, Parameter
line = Line(StartPoint=evaluate_length_2.Point, EndPoint=evaluate_length.Point)
perp_frame = PerpFrame(Curve=flip_curve.Curve, Parameter=evaluate_length.Parameter)
perp_frame_2 = PerpFrame(Curve=curve_5, Parameter=evaluate_length_2.Parameter)
cone = Cone(Base=[perp_frame_2, perp_frame], Radius=radius_2, Length=expr("-x", clearance))  # -> Cone, Tip
mesh_difference = MeshDifference(MeshesA=mesh_sphere, MeshesB=cone.Cone)
pipe = Pipe(Curve=line, Radius=radius_2, Caps=0)

create_material_3 = CreateMaterial(
    Diffuse=ColourSwatch(SwatchColor=RGB(136, 58, 23)),
    Specular=RGB(255, 255, 255),
    Emission=ColourSwatch(SwatchColor=RGB(6, 29, 64)),
    Transparency=0,
    Shine=0)
create_material_4 = CreateMaterial(
    Diffuse=ColourSwatch(SwatchColor=RGB(125, 125, 125)),
    Specular=ColourSwatch(SwatchColor=RGB(125, 125, 125)),
    Emission=RGB(0, 0, 0),
    Transparency=0,
    Shine=Slider(20, range=0..100))
custom_preview_3 = CustomPreview(Geometry=pipe, Material=create_material_3)
custom_preview_4 = CustomPreview(Geometry=mesh_difference, Material=create_material_4)
custom_preview_5 = CustomPreview(Geometry=cone.Cone, Material=create_material_4)
